test file "PetermanModelTestCases"

suite "New Test Suite 1"

  case "New Test Case 1" [baseline]
    model BasicPumpPlant
    assessment "Assessment1": At any point of time, whenever PumpPressure_psi > 150 is true then, with no delay, PumpPressure_psi > 150 must stay true until PumpPressure_psi < 150 becomes true (within 1)
    assessment "Assessment2": At any point of time, if CurrentSB == 1500 & PressurePort_psi == 440 becomes true and stays true for at least 1 then, starting from rising edge of trigger, with a delay of at most 3, PumpPressure_psi < 150 must stay true until PumpPressure_psi < 150 becomes true (within 1)
    assessment "Assessment3": At any point of time, if CurrentSB == 1500 & PressurePort_psi == 440 becomes true and stays true for at least 1 then, starting from rising edge of trigger, with a delay of at most 10, PumpPressure_psi < 150 must stay true until PumpPressure_psi < 150 becomes true (within 1)
    assessment "Assessment4": At any point of time, PumpFlowModel must be greater than 247.5 and less than 252.5
    assessment "Assessment5": At any point of time, PumpFlowModel must be greater than 99 and less than 101
    assessment "Assessment6": At any point of time, DSOutletArea must be greater than or equal to 95 and less than or equal to 100
    assessment "Assessment7": At any point of time, if ShaftSpeed > 1000 becomes true and stays true for at least 1 then, starting from rising edge of trigger, with no delay, ShaftSpeed <= 1000 must stay true for at most 10
      PumpPressure_psi: signal BasicPumpPlant/SolutionPumpPlantModel, port 3
      PumpFlowModel: signal BasicPumpPlant/SolutionPumpPlantModel, port 2
      CurrentSB: signal BasicPumpPlant/PID Controller, port 1
      PressurePort_psi: signal BasicPumpPlant/Constant2, port 1
      DSOutletArea: signal BasicPumpPlant/TDSOA_Constant, port 1
      ShaftSpeed: signal BasicPumpPlant/SolutionPumpPlantModel, port 1